# Grasshopper definition firefly_turning_tower.gh (Grasshopper 0.9.76)
# plug-ins: Firefly.Core

# ---- group: FIREFLY
ports_available = COMPortsAvailable()
timer = Timer(TimerInterval=200, Target=uno_read)
panel = Panel(ports_available)
open_port = OpenClosePort(OpenClosePort=Toggle(False), PortNumber=ports_available, BaudRate=115200)
uno_read = UnoRead(StartReadingValues=Toggle(False), PortNumber=ports_available)  # -> AnalogPin0, AnalogPin1, AnalogPin2, AnalogPin3, AnalogPin4, AnalogPin5, DigitalPin2, DigitalPin4, DigitalPin7, StatusMessage
panel_2 = Panel(open_port)
panel_3 = Panel(uno_read.StatusMessage)
panel_4 = Panel(uno_read.AnalogPin0)

# ----
# Turning Tower
# 
# From a closed and planar curve created in Rhinoceros 3D, moved into the axis Z by a series of 100 values, rotated by a range of 100 values from 0º to a specific angle determined by the plug-in Firefly and scaled by a range of 100 values from 10% to 100%; the curves were then transformed into a lofted surface and a planar surface, representing a skyscraper skin and its floors.
# The maximum rotation angle of the floors are remaped values read from a potentiometer connected to an Arduino <https://www.arduino.cc/>, and communicating with Grasshopper3D with the plug-in Firefly <http://www.fireflyexperiments.com/>.
# 
#   created May 4th, 2017
#   by Orion Campos
# <www.orioncampos.com> <https://github.com/orion-campos>
crv = Curve(<curve referenced from the Rhino model>)

# ---- group: MOVE
number_slider = Slider(100, range=0..100)
series = Series(Start=0, Step=Slider(3, range=0..10), Count=number_slider)
Z = UnitZ(Factor=series)
move = Move(Geometry=crv, Motion=Z)  # -> Geometry, Transform

# ----
area = Area(Geometry=crv)  # -> Area, Centroid
subtraction = Subtraction(A=number_slider, B="1")

# ---- group: ROTATE
dom = ConstructDomain(DomainStart="0", DomainEnd="1023")
dom_2 = ConstructDomain(DomainStart=Slider(0, range=0..100), DomainEnd=Slider(360, range=0..360))
remap = RemapNumbers(Value=uno_read.AnalogPin0, Source=dom, Target=dom_2)  # -> Mapped, Clipped
dom_3 = ConstructDomain(DomainStart=0, DomainEnd=remap.Mapped)
range = Range(Domain=dom_3, Steps=subtraction)
rotate = Rotate(Geometry=move.Geometry, Angle=degrees(range), Plane=area.Centroid)  # -> Geometry, Transform

# ---- group: SCALE
dom_4 = ConstructDomain(DomainStart=Slider(1, range=0..1), DomainEnd=Slider(0.1, range=0..1))
range_2 = Range(Domain=dom_4, Steps=subtraction)
area_2 = Area(Geometry=rotate.Geometry)  # -> Area, Centroid
scale = Scale(Geometry=rotate.Geometry, Center=area_2.Centroid, Factor=range_2)  # -> Geometry, Transform

# ----
loft = Loft(Curves=scale.Geometry, Options={Adjust=False, Closed=False, LoftEnds=0, LoftSimp=0, LoftType=0, Rebuild=10, Refit=0.01})
boundary = BoundarySurfaces(Edges=scale.Geometry)
