# Grasshopper definition 1_circles.gh (Grasshopper 0.9.76)

# Circles
# 
# Create circles on XY plane which radius are controlled by a slider, from points created on Rhinoceros 3D
# 
#   created May 4th, 2017
#   by Orion Campos
# <www.orioncampos.com> <https://github.com/orion-campos>
pt = Point([<point referenced from the Rhino model> x10])
xy = XYPlane(Origin=pt)
cir = Circle(Plane=xy, Radius=Slider(88, range=0..100))
