# Grasshopper definition 2_turning_tower.gh (Grasshopper 0.9.76)

# Turning Tower
# 
# From a closed and planar curve created in Rhinoceros 3D, moved into the axis Z by a series of 100 values, rotated by a range of 100 values from 0º to 360º and scaled by a range of 100 values from 10% to 100%; the curves were then transformed into a lofted surface and a planar surface, representing a skyscraper skin and its floors.
# 
#   created May 4th, 2017
#   by Orion Campos
# <www.orioncampos.com> <https://github.com/orion-campos>
crv = Curve(<curve referenced from the Rhino model>)

# ---- group: MOVE
number_slider = Slider(100, range=0..100)
series = Series(Start=0, Step=Slider(3, range=0..10), Count=number_slider)
Z = UnitZ(Factor=series)
move = Move(Geometry=crv, Motion=Z)  # -> Geometry, Transform

# ----
area = Area(Geometry=crv)  # -> Area, Centroid

# ---- group: ROTATE
dom = ConstructDomain(DomainStart=Slider(0, range=0..1000), DomainEnd=Slider(360, range=0..360))
subtraction = Subtraction(A=number_slider, B="1")
range = Range(Domain=dom, Steps=subtraction)
rotate = Rotate(Geometry=move.Geometry, Angle=degrees(range), Plane=area.Centroid)  # -> Geometry, Transform

# ---- group: SCALE
dom_2 = ConstructDomain(DomainStart=Slider(1, range=0..1), DomainEnd=Slider(0.1, range=0..1))
subtraction_2 = Subtraction(A=number_slider, B="1")
range_2 = Range(Domain=dom_2, Steps=subtraction_2)
area_2 = Area(Geometry=rotate.Geometry)  # -> Area, Centroid
scale = Scale(Geometry=rotate.Geometry, Center=area_2.Centroid, Factor=range_2)  # -> Geometry, Transform

# ----
loft = Loft(Curves=scale.Geometry, Options={Adjust=False, Closed=False, LoftEnds=0, LoftSimp=0, LoftType=0, Rebuild=10, Refit=0.01})
boundary = BoundarySurfaces(Edges=scale.Geometry)
