# Grasshopper definition 3_attractor_points.gh (Grasshopper 0.9.76)

number_slider = Slider(20, range=0..100)
# Attractor Points
# 
# Create a series of points, in a rectangular grid, which radius and colors are related to the distance to the closest attractor point.
# 
#   created May 4th, 2017
#   by Orion Campos
# <www.orioncampos.com> <https://github.com/orion-campos>
number_slider_2 = Slider(5, range=0..10)
pt = Point([<point referenced from the Rhino model> x3])
number_slider_3 = Slider(2.5, range=0..10)
number_slider_4 = Slider(0, range=0..10)
sqgrid = Square(Plane=PlaneXY(0, 0, 0), Size=number_slider_2, ExtentX=number_slider, ExtentY=number_slider)  # -> Cells, Points
flatten = FlattenTree(Tree=sqgrid.Points, Path="{0}")
cp = ClosestPoint(Point=flatten, Cloud=pt)  # -> ClosestPoint, CPIndex, Distance
bnd = Bounds(Numbers=cp.Distance)
dom = ConstructDomain(DomainStart=number_slider_3, DomainEnd=number_slider_4)
ln = Line(StartPoint=flatten, EndPoint=cp.ClosestPoint)
remap = RemapNumbers(Value=cp.Distance, Source=bnd, Target=dom)  # -> Mapped, Clipped
cir = Circle(Plane=flatten, Radius=remap.Mapped)
gradient = Gradient(
    LowerLimit=number_slider_3,
    UpperLimit=number_slider_4,
    Parameter=remap.Mapped,
    stops=[0: RGB(234, 38, 0), 0.25: RGB(234, 126, 0), 0.5: RGB(254, 244, 84), 0.75: RGB(173, 203, 249), 1: RGB(75, 107, 169)])
boundary = BoundarySurfaces(Edges=cir)
preview = CustomPreview(Geometry=boundary, Shader=gradient)
