# Grasshopper definition shell.gh (Grasshopper 0.9.76)

construct_point = ConstructPoint(XCoordinate=0, YCoordinate=0, ZCoordinate=0)
construct_point_2 = ConstructPoint(XCoordinate=0, YCoordinate=0, ZCoordinate=0)
circle = Circle(Plane=construct_point, Radius=Slider(100, range=0..100))
circle_2 = Circle(Plane=construct_point_2, Radius=Slider(86, range=0..100))
divide_curve = DivideCurve(Curve=circle, Count=Slider(10, range=0..50), Kinks=False)  # -> Points, Tangents, Parameters
number_slider = Slider(5, range=0..10)
divide_curve_2 = DivideCurve(Curve=circle_2, Count=Slider(8, range=0..50), Kinks=False)  # -> Points, Tangents, Parameters
curve = Curve(<curve referenced from the Rhino model>)
circle_3 = Circle(Plane=divide_curve.Points, Radius=Slider(59, range=0..100))
circle_4 = Circle(Plane=divide_curve_2.Points, Radius=Slider(50, range=0..100))
number_slider_2 = Slider(5, range=0..10)
perp_frames = PerpFrames(Curve=curve, Count=number_slider, Align=True)  # -> Frames, Parameters
region_union = RegionUnion(Curves=flatten([circle, circle_3]))
region_union_2 = RegionUnion(Curves=flatten([circle_2, circle_4]))
panel = Panel(perp_frames.Frames)
series = Series(Start=0, Step=Slider(100, range=0..1000), Count=number_slider_2)
orient = Orient(Geometry=region_union, Source=PlaneXY(0, 0, 0), Target=perp_frames.Frames)  # -> Geometry, Transform
subtraction = Subtraction(A=number_slider_2, B=1)
panel_2 = Panel(series)
unit_z = UnitZ(Factor=series)
range = Range(Domain=Domain(0, 1), Steps=number_slider)
panel_3 = Panel(range)
range_2 = Range(Domain=Domain(0, 1), Steps=subtraction)
panel_4 = Panel(range_2)
move = Move(Geometry=region_union_2, Motion=unit_z)  # -> graft(Geometry), Transform
graph_mapper = GraphMapper(
    range,
    x0=0,
    x1=1,
    y0=0,
    y1=1,
    container_name="Bezier",
    cpx=[0, 0.4163586795, 0.5269972086, 1],
    cpy=[0.4980919361, 1, 1, 0.5516563654])
graph_mapper_2 = GraphMapper(
    range_2,
    x0=0,
    x1=1,
    y0=0,
    y1=1,
    container_name="Bezier",
    cpx=[0, 0.4608521163, 0.5750032067, 1],
    cpy=[0.6419546604, 0.9828294516, 1, 0.5430266857])
area = Area(Geometry=move.Geometry)  # -> Area, Centroid
panel_5 = Panel(graph_mapper)
panel_6 = Panel(graph_mapper_2)
scale = Scale(Geometry=move.Geometry, Center=area.Centroid, Factor=graft(graph_mapper_2))  # -> Geometry, Transform
scale_2 = Scale(Geometry=orient.Geometry, Center=perp_frames.Frames, Factor=graph_mapper)  # -> Geometry, Transform
panel_7 = Panel(scale_2.Geometry)
addition = Addition(A=number_slider, B=1)
series_2 = Series(Start=Slider(928, range=0..1000), Step=Slider(33, range=0..1000), Count=addition)
panel_8 = Panel(series_2)
series_3 = Series(Start=Slider(0, range=0..1000), Step=Slider(36, range=0..1000), Count=number_slider_2)
panel_9 = Panel(series_3)
rotate = Rotate(Geometry=scale_2.Geometry, Angle=degrees(series_2), Plane=perp_frames.Frames)  # -> flatten(Geometry), Transform
rotate_2 = Rotate(Geometry=scale.Geometry, Angle=graft(degrees(series_3)), Plane=PlaneXY(0, 0, 0))  # -> flatten(Geometry), Transform
loft = Loft(Curves=rotate.Geometry, Options={Adjust=False, Closed=False, LoftEnds=0, LoftSimp=0, LoftType=0, Rebuild=10, Refit=0.01})
loft_2 = Loft(
    Curves=rotate_2.Geometry,
    Options={Adjust=False, Closed=False, LoftEnds=0, LoftSimp=0, LoftType=0, Rebuild=10, Refit=0.01})
cap_holes_ex = CapHolesEx(Brep=loft)  # -> Brep, Caps, Solid
cap_holes_ex_2 = CapHolesEx(Brep=loft_2)  # -> Brep, Caps, Solid
panel_10 = Panel(cap_holes_ex.Brep)
panel_11 = Panel(cap_holes_ex_2.Brep)
volume = Volume(Geometry=cap_holes_ex.Brep)  # -> Volume, Centroid
scale_3 = Scale(Geometry=cap_holes_ex.Brep, Center=volume.Centroid, Factor=Slider(0.9, range=0..1))  # -> Geometry, Transform
panel_12 = Panel(scale_3.Geometry)
